# Dynamo graph CriarTabela.dyn (Dynamo 2.10.1.3976)

current = Document.Current()
activeView = Document.ActiveView(document=current)
largura = DoubleSlider(5.3, range=0.1..10 step 0.1)
comprimento = DoubleSlider(4, range=0.1..10 step 0.1)
colunas = DoubleSlider(3, range=1..30 step 1)
linhas = DoubleSlider(3, range=1..30 step 1)
criarCelulas = Python(IN[0]=activeView, IN[1]=largura, IN[2]=comprimento, IN[3]=colunas, IN[4]=linhas)  # IronPython2
# ---------- criarCelulas.python (37 lines) ----------
# Carregar as bibliotecas DesignScript e padrão do Python
import sys
import clr
clr.AddReference('ProtoGeometry')
from Autodesk.DesignScript.Geometry import *

view = IN[0]
largura = IN[1]
comprimento = IN[2]
colunas = int(IN[3])
linhas = int(IN[4])
tabela = []

def criar_retangulo():
	retangulo = Rectangle.ByWidthLength(largura,comprimento)
	exploded = Geometry.Explode(retangulo)
	#curves = DetailCurve.ByCurve(view,exploded)
	return exploded
	
def mover(lista):
	geometria = []
	for item in lista:
		item = Geometry.Translate(item,coluna*(largura/colunas),linha*(comprimento/linhas),0)
		geometria.append(item)
	return geometria

for linha in range(linhas):
	l = []
	
	for coluna in range(colunas):
		celula = criar_retangulo()
		celula = mover(celula)
		l.append(celula)
		
	tabela.append(l[:])

OUT = tabela
# ----------------------------------------
byCurve = DetailCurve.ByCurve(view=activeView, curve=criarCelulas)
byCurve_2 = DetailCurve.ByCurve()  # unwired: view, curve
