# Dynamo graph Table.dyn (Dynamo 2.10.1.3976)

watch = Watch()  # unwired: arg0
views = Views()  # nothing selected
current = Document.Current()  # frozen
python_script = Python(IN[0]=views, IN[1]=current)  # CPython3; graph output
# ---------- python_script.python (31 lines) ----------
# Carregar as bibliotecas DesignScript e padrão do Python
import sys
import clr
clr.AddReference('ProtoGeometry')
from Autodesk.DesignScript.Geometry import *

clr.AddReference('RevitAPI')
import Autodesk
from Autodesk.Revit.DB import Transaction

clr.AddReference("RevitServices")
import RevitServices
from RevitServices.Persistence import DocumentManager
doc = DocumentManager.Instance.CurrentDBDocument
t = Transaction(doc, 'Name')

element = UnwrapElement(IN[0])

t.Start()
table_data = element.GetTableData()

for i in range(10):
	table_data.GetSectionData(0).InsertColumn(1)
t.Commit()






OUT = 0
# ----------------------------------------
watch_2 = Watch(python_script)
python_script_2 = Python()  # CPython3; unwired: IN[0]
# ---------- python_script_2.python (38 lines) ----------
# Load the Python Standard and DesignScript Libraries
import sys
import clr

clr.AddReference("RevitServices")
import RevitServices
from RevitServices.Persistence import DocumentManager
from RevitServices.Transactions import TransactionManager

clr.AddReference("RevitAPI")

from Autodesk.Revit.DB import  (Transaction, ViewSchedule, 
                               ElementId, BuiltInCategory,
                               SchedulableField,ScheduleFieldType,
                               ScheduleDefinition)

doc = DocumentManager.Instance.CurrentDBDocument
uiapp = DocumentManager.Instance.CurrentUIApplication
app = uiapp.Application

tran = Transaction(doc)
tran.Start("Criar Tabela")

sampleSchedule = ViewSchedule.CreateSchedule(doc,ElementId(BuiltInCategory.OST_PipeCurves))

parameters = ViewSchedule.GetAvailableParameters(doc,ElementId(BuiltInCategory.OST_PipeCurves)) 

for param in parameters:
    try:
        sampleSchedule.Definition.AddField(SchedulableField(ScheduleFieldType.Instance, id))
    except:
        pass

    sampleDefinition = sampleSchedule.Definition
    
tran.Commit()

uidoc.ActiveView = sampleSchedule
# ----------------------------------------
